# Grasshopper definition MARA_CAD.gh (Grasshopper 1.0.8)

pipeline = GeometryPipeline(
    GroupByLayer=False,
    GroupByType=False,
    IncludeHidden=True,
    IncludeLocked=True,
    LayerFilter="bricks",
    NameFilter="*",
    SublayerFiltering=True,
    TypeFilter=1073741848)
pipeline_2 = GeometryPipeline(
    GroupByLayer=False,
    GroupByType=False,
    IncludeHidden=True,
    IncludeLocked=True,
    LayerFilter="FIDUCIARY",
    NameFilter="*",
    SublayerFiltering=True,
    TypeFilter=4)
volume = Volume(Geometry=pipeline)  # -> Volume, Centroid
pcen = PolygonCenter(Polyline=pipeline_2)  # -> CenterV, CenterE, CenterA
pdecon = Deconstruct(Point=volume.Centroid)  # -> XComponent, YComponent, ZComponent
sort = SortList(Keys=pdecon.ZComponent, ValuesA=pipeline)  # -> Keys, ValuesA
debrep = DeconstructBrep(Brep=sort.ValuesA)  # -> Faces, Edges, Vertices
evalsrf = EvaluateSurface(Surface=reparameterize(debrep.Faces), Point="0.5,0.5")  # -> Point, Normal, UDirection, VDirection, Frame
pdecon_2 = Deconstruct(Point=evalsrf.Point)  # -> XComponent, YComponent, ZComponent
sort_2 = SortList(Keys=pdecon_2.ZComponent, ValuesA=evalsrf.Point)  # -> Keys, ValuesA
item = ListItem(List=sort_2.ValuesA, Index=0, Wrap=True)  # -> flatten(Item)
bricks_to_json = Python3Script(TAG=pcen.CenterV, PTS=item, PATH="C:\MARA_1\MARA_ws\wall.json", WRITE=Button())  # -> OUTPATH, COUNT; inputs TAG: Point3d, PTS: list of Point3d, PATH: String, WRITE: Boolean
# ---------- bricks_to_json: Python ----------
"""Export brick points relative to a tag point to a minimal JSON list of [x, y, z]."""

import json, os

OUTPATH = ""
COUNT = 0

if WRITE:
    if not PATH or not isinstance(PATH, str):
        raise ValueError("PATH must be a valid string file path, e.g. C:\\\\MARA_1\\\\data\\\\wall_simple.json")
    if TAG is None:
        raise ValueError("TAG point is required.")
    if not PTS:
        raise ValueError("PTS list is empty.")

    folder = os.path.dirname(PATH)
    if folder and not os.path.exists(folder):
        os.makedirs(folder)

    data = []
    for p in PTS:
        x_rel = (p.Y - TAG.Y) / 1000.0
        y_rel = (TAG.X - p.X) / 1000.0
        z_rel = (p.Z - TAG.Z) / 1000.0
        data.append([round(x_rel, 3), round(y_rel, 3), round(z_rel, 3)])

    with open(PATH, "w") as f:
        json.dump(data, f, indent=2)

    OUTPATH = PATH
    COUNT = len(data)
# ---------- end bricks_to_json ----------
panel = Panel(bricks_to_json.COUNT)
